# Grasshopper definition 0A_con modify.gh (Grasshopper 1.0.7)
# plug-ins: KarambaIDEA

file_path = FilePath("C:\Users\NathanLuke\Desktop\Con Parameters Calculations\templateexport.contemp")
c_script = CSharpScript(filetype=".contemp")  # -> filepath; inputs filetype: String
# ---------- c_script: C# usings ----------
using System.IO;
# ---------- c_script: C# ----------
    string path = this.Component.OnPingDocument().FilePath;

    string directory = Path.GetDirectoryName(path);

    string[] files = Directory.GetFiles(directory, string.Concat('*', filetype));

    filepath = files;
# ---------- end c_script ----------
template_by_filepath = TemplateByFilepath(Path=c_script)
c_script_2 = CSharpScript(x=".ideaCon")  # -> out, A; inputs x: String
# ---------- c_script_2: C# ----------
    string path = this.Component.OnPingDocument().FilePath;

    string directory = Path.GetDirectoryName(path);

    string[] files = Directory.GetFiles(directory, string.Concat('*',x));

    A = files;
# ---------- end c_script_2 ----------
deconstruct_template = DeconstructTemplate(Template=template_by_filepath)
list_item = ListItem(List=c_script_2.A, Index=0, Wrap=True)  # -> Item, Item1
set_param_value = SetParamValue(Parameter=deconstruct_template, Value="0.005")
file_path_2 = FilePath(list_item.Item)
panel = Panel(deconstruct_template)
# Add dontsave/save/save-as button?
# Add save as suffix option
boolean_toggle = BooleanToggle(False)
button = Button()
modify_con_parameters = ModifyConParameters(Parameters=set_param_value)
reference_connection = ReferenceConnection(Path=file_path_2, LoadInfo=False)
calculate_connection = CalculateConnection(Connection=reference_connection, Modifications=modify_con_parameters, Run_IDEA=boolean_toggle)
export_modelbim = ExportModelBIM()
# Creating HUB (TU Delft student request)
# Template assign in same branch will be both applied to related joint? Allowing series of templates being applied
# Welded Partial Template
# Bolted Partial Template
panel_3 = Panel(modify_con_parameters)
panel_4 = Panel("PP1a")
connection_internalised = Data()
connection_results = ConnectionResults(Connection=connection_internalised)  # -> Name, SummaryResults, PlateResults, WeldResults, BoltResults, AnchorResults, ConcreteBlockResults
deconstruct_item_result = DeconstructItemResult(ItemResult=connection_results.SummaryResults)  # -> Name, CheckStatus, UnityCheck, PlMaxStress, PlMaxStrain, Items, ItemId, CheckMsg
deconstruct_item_result_2 = DeconstructItemResult(ItemResult=connection_results.WeldResults)  # -> Name, CheckStatus, UnityCheck, PlMaxStress, PlMaxStrain, Items, ItemId, CheckMsg
panel_5 = Panel(deconstruct_item_result.CheckStatus)
panel_6 = Panel(deconstruct_item_result.UnityCheck)
panel_7 = Panel(deconstruct_item_result.Name)
panel_8 = Panel(deconstruct_item_result.CheckMsg)
panel_9 = Panel(deconstruct_item_result_2.Name)
# Types of brep geometry: Plate, Stiffener member, Bolt, Weld
panel_10 = Panel(deconstruct_item_result_2.UnityCheck)
